# Grasshopper definition 1_15th of month.ghx (Grasshopper 1.0.8)

number_slider = Slider(10, range=0..10)
number_slider_2 = Slider(16, range=0..100)
number_slider_3 = Slider(15, range=0..15)
number_slider_4 = Slider(8, range=0..12)
analysisperiod = LBAnalysisPeriod(
    start_month=number_slider_4,
    start_day=number_slider_3,
    start_hour=Slider(6, range=0..24),
    end_month=number_slider_4,
    end_day=number_slider_3,
    end_hour=Slider(7, range=0..24),
    timestep=Slider(1, range=0..1))  # -> period, hoys, dates; plug-in component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
weather_epw_file = FilePath("C:\Users\tuval\Downloads\ISR_Beer.Sheva.401900_MSI.epw")
weather_stat_file = FilePath("C:\Users\tuval\Downloads\ISR_Beer.Sheva.401900_MSI.stat")
importepw = LBImportEPW(epw_file=weather_epw_file)  # -> location, dry_bulb_temperature, dew_point_temperature, relative_humidity, wind_speed, wind_direction, direct_normal_rad, diffuse_horizontal_rad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; plug-in component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
importloc = LBImportLocation(epw_file=weather_epw_file)  # -> location; plug-in component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
applyper = LBApplyAnalysisPeriod(data=importepw.wind_speed, period=analysisperiod.period)  # -> data; plug-in component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
applyper_2 = LBApplyAnalysisPeriod(data=importepw.wind_direction, period=analysisperiod.period)  # -> data; plug-in component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
importstat = LBImportSTAT(stat_file=weather_stat_file)  # -> location, ashrae_zone, koppen_zone, clear_dir_norm_rad, clear_diff_horiz_rad, ann_heat_dday_996, ann_heat_dday_990, ann_cool_dday_004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; plug-in component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
panel = Panel(importstat.extreme_hot_week)
pt = Point(Point(462.4443673, 2583.459108, 0))
windrose = LBWindRose(data=applyper, wind_direction=applyper_2, center_pt=pt)  # -> report, mesh, compass, orient_line, freq_line, windrose_line, legend, title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; plug-in component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
sunpath = LBSunPath(location=importloc, hoys=analysisperiod.hoys, center_pt=pt, scale=Slider(6, range=0..10), daily=Toggle(True))  # -> out, vectors, altitudes, azimuths, hoys, sun_pts, analemma, daily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; plug-in component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
vector = Vector(sunpath.vectors)
line = Line(StartPoint=pt, EndPoint=sunpath.sun_pts)
amplitude = Amplitude(Vector=vector, Amplitude=Slider(100, range=0..100))
vector_length = VectorLength(Vector=vector)
colrange = LBColorRange(index=Slider(1, range=0..25))  # -> colors; plug-in component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
legendpar = LBLegendParameters(min=Slider(13, range=0..30), max=Slider(43, range=0..100), colors=colrange)  # -> leg_par; plug-in component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
analysisperiod_2 = LBAnalysisPeriod(start_month=1, start_day=1, start_hour=0)  # -> period, hoys, dates; plug-in component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
brep = Brep([<brep referenced from the Rhino model> x951])
surface = Surface(<surface referenced from the Rhino model>)
srf = Surface(<surface referenced from the Rhino model>)
brep_2 = Brep([<brep referenced from the Rhino model> x949])
genpts = LBGeneratePointGrid(geometry=surface, grid_size=Slider(10, range=0..30))  # -> points, vectors, face_areas, graft(mesh); plug-in component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
directsunhours = LBDirectSunHours(
    vectors=flatten(sunpath.vectors),
    geometry=flatten(surface),
    context=flatten(brep),
    grid_size=Slider(5, range=0..10),
    legend_par=legendpar,
    run=Toggle(True))  # -> out, points, results, mesh, legend, title, int_mtx; plug-in component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
applyper_3 = LBApplyAnalysisPeriod(data=importepw.diffuse_horizontal_rad, period=analysisperiod.period)  # -> data; plug-in component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
applyper_4 = LBApplyAnalysisPeriod(data=importepw.direct_normal_rad, period=analysisperiod.period)  # -> data; plug-in component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
applyper_5 = LBApplyAnalysisPeriod(data=importepw.dry_bulb_temperature, period=analysisperiod.period)  # -> data; plug-in component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
applyper_6 = LBApplyAnalysisPeriod(data=importepw.relative_humidity, period=analysisperiod.period)  # -> data; plug-in component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
applyper_7 = LBApplyAnalysisPeriod(data=importepw.horizontal_infrared_rad, period=analysisperiod.period)  # -> data; plug-in component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
list_length = ListLength(List=directsunhours.results)
humantosky = LBHumanToSkyRelation(location=importepw.location, position=flatten(genpts.points), context=flatten(brep), run=Toggle(False))  # -> report, human_points, human_line, fract_body_exp, sky_exposure; plug-in component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
mass_addition = MassAddition(Input=directsunhours.results)  # -> Result, PartialResults
division = Division(A=mass_addition.Result, B=list_length)
applyper_8 = LBApplyAnalysisPeriod(data=humantosky.fract_body_exp, period=analysisperiod.period)  # -> data; plug-in component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
multiplication = Multiplication(A=division, B=Slider(100, range=0..100))
xdata = LBDeconstructData(data=applyper_8)  # -> header, values; plug-in component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
round = Round(Number=multiplication)  # -> Nearest, Floor, Ceiling
avr = Average(Input=xdata.values)  # -> flatten(ArithmeticMean)
panel_2 = Panel(avr)
outdoorsolarmrt = LBOutdoorSolarMRT(
    location=importepw.location,
    surface_temp=applyper_5,
    dir_norm_rad=applyper_4,
    diff_horiz_rad=applyper_3,
    horiz_infrared=applyper_7,
    fract_body_exp=panel_2,
    sky_exposure=humantosky.sky_exposure,
    run=Toggle(False))  # -> report, short_erf, long_erf, short_dmrt, long_dmrt, mrt; plug-in component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
utci = LBUTCIComfort(air_temp=applyper_5, mrt=outdoorsolarmrt.mrt, rel_humid=applyper_6, wind_vel=applyper, run=Toggle(False))  # -> out, utci, comfort, condition, category, comf_obj; plug-in component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
xdata_2 = LBDeconstructData(data=utci.utci)  # -> header, values; plug-in component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
hourlyplot = LBHourlyPlot(data=utci.category)  # -> report, mesh, legend, borders, labels, title, vis_set; plug-in component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
avr_2 = Average(Input=xdata_2.values)  # -> flatten(ArithmeticMean)
panel_3 = Panel(avr_2)
concatenate = Concatenate(Fragment_A=round.Nearest, Fragment_B="%", A=" surface area exposed to direct sunlight")
panel_4 = Panel(concatenate)
heatmap = LBSpatialHeatmap(values=avr_2, mesh=genpts.mesh, legend_par=legendpar)  # -> mesh, legend, title, colors, legend_par, vis_set; plug-in component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
mesh = Mesh(heatmap.mesh)
hatch = LBMeshToHatch(mesh=heatmap.mesh)  # -> report; plug-in component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
